test file "EquivalenceTestFile" (disabled: Disabled for the DC 1)
  description: #design Clouds
  tags: #DC, 1
  setup callback:
    disp('right tc pre load-Simulation 1');
    disp('Designs cloud Tests');
    disp('You can use the Test Manager to create test cases for Simulink® models and code in desktop, SIL, PIL, and HIL (for target computers running Simulink Real-Time™) execution environments. You can create or import test data, run tests, view results, and create reports. You can also import and test C and C++ code, and MATLAB® test scripts. ')
    disp('Designs cloud Tests');
    disp('Designs cloud Tests');
    disp('Designs cloud Tests');
    disp('Designs cloud Tests');
    disp('Designs cloud Tests');
    disp('Designs cloud Tests');
    disp('Designs cloud Tests');
    disp('Designs cloud Tests');
    disp('Designs cloud Tests');
    disp('Designs cloud Tests');
    disp('Designs cloud Tests');
    disp('Designs cloud Tests');
    disp('Designs cloud Tests');
    disp('Designs cloud Tests');
  cleanup callback: same code as in setup callback of test file "EquivalenceTestFile"
  coverage: Decision, MCDC, SignalRange, SimulinkDesignVerifier, RelationalBoundary, Condition, LookupTable, SignalSize, SaturationOnIntOverflow

suite "New Test Suite 1" (disabled)

  case "New Test Case 1" [equivalence] (disabled)
    description: left Equivalence  test case
    tags: baseline, testcase, left
    test data file: mCruise_control_sldvdataTheirs.xlsx
    simulation 1:
      model mAllIterationOptionsTheirs, harness mAllIterationOptionsTheirs_Harness2 (for mAllIterationOptionsTheirs/Subsystem), mode Normal, start time 5, stop time 100, initial state true
      configuration set: Configuration1
      parameter set "Parameter Set 1" (off): b = 3.1412  % model workspace
      parameter set "dInputs_LaunchData2.mat" (off): ts1 = 1x1 timeseries, ts2 = 1x1 timeseries
      parameter set "dBaseline_RightTest.mat" (off): data = 1x1 Simulink.SimulationData.Dataset
      parameter set "dBaseline_RightTest_Theirs.mat": data = 1x1 Simulink.SimulationData.Dataset
      input "dBaseline_RightTest_Theirs.mat"
      input "dInputs_LaunchData2.mat"
      input "dBaseline_RightTest.mat"
      input "Test case_1" from mCruise_control_sldvdataMine.xlsx
      input "Test case_2" from mCruise_control_sldvdataMine.xlsx
      input "Test case_3" from mCruise_control_sldvdataMine.xlsx
      input "Test case_1 (1)" from mCruise_control_sldvdataTheirs.xlsx, sheet Test case_1
      input "Test case_2 (1)" from mCruise_control_sldvdataTheirs.xlsx, sheet Test case_2
      input "Test case_3 (1)" from mCruise_control_sldvdataTheirs.xlsx, sheet Test case_3
      input "Test case_1 (2)" from mCruise_control_sldvdataMine.xlsx, sheet Test case_1
      input "Test case_2 (2)" from mCruise_control_sldvdataMine.xlsx, sheet Test case_2
      input "Test case_3 (2)" from mCruise_control_sldvdataMine.xlsx, sheet Test case_3
      input "dInputs_LaunchData2.mat (1)" from dInputs_LaunchData2.mat (active)
      logged signals "Signal Set 1" (off): Output Conversion Subsystem:1, Input Conversion Subsystem:1, In1:1, Output Conversion Subsystem:1
      logged signals "Signal Set 2" (off): In1:1
      logged signals "Signal Set 3" (off): Input Conversion Subsystem:1
      logged signals "Signal Set 4": Subsystem:1, Output Conversion Subsystem:1
      start logging when A == true
      stop logging after 600 s
      pre-load callback: same code as in setup callback of test file "EquivalenceTestFile"
      post-load callback: same code as in setup callback of test file "EquivalenceTestFile"
      cleanup callback: same code as in setup callback of test file "EquivalenceTestFile"
    simulation 2:
      model mAllIterationOptions, harness mAllIterationOptions_Harness1 (for mAllIterationOptions/Subsystem), mode Rapid Accelerator
      parameter set "Parameter Set 2": a = 9.8  % model workspace
      input "dInputs_LaunchData2.mat" (active)
      logged signals "Signal Set 2": Gain:1
      pre-load callback:
        disp('right tc post load-Simulation 2');
      post-load callback:
        disp('right tc pre load-Simulation 2');
      cleanup callback:
        disp('right tc cleanup-Simulation 2');
    equivalence criteria
      Out1
    custom criteria:
      test.verifyTrue(true);
      disp('right tc pre load-Simulation 1');
      disp('Designs cloud Tests');
      disp('You can use the Test Manager to create test cases for Simulink® models and code in desktop, SIL, PIL, and HIL (for target computers running Simulink Real-Time™) execution environments. You can create or import test data, run tests, view results, and create reports. You can also import and test C and C++ code, and MATLAB® test scripts. ')
      disp('Designs cloud Tests');
      disp('Designs cloud Tests');
      disp('Designs cloud Tests');
      disp('Designs cloud Tests');
      disp('Designs cloud Tests');
      disp('Designs cloud Tests');
      disp('Designs cloud Tests');
      disp('Designs cloud Tests');
      disp('Designs cloud Tests');
      disp('Designs cloud Tests');
      disp('Designs cloud Tests');
      disp('Designs cloud Tests');
      disp('Designs cloud Tests');
      disp('Designs cloud Tests');
    assessment callback:
      A=100;
      disp('right tc pre load-Simulation 1');
      disp('Designs cloud Tests');
      disp('You can use the Test Manager to create test cases for Simulink® models and code in desktop, SIL, PIL, and HIL (for target computers running Simulink Real-Time™) execution environments. You can create or import test data, run tests, view results, and create reports. You can also import and test C and C++ code, and MATLAB® test scripts. ')
      disp('Designs cloud Tests');
      disp('Designs cloud Tests');
      disp('Designs cloud Tests');
      disp('Designs cloud Tests');
      disp('Designs cloud Tests');
      disp('Designs cloud Tests');
      disp('Designs cloud Tests');
      disp('Designs cloud Tests');
      disp('Designs cloud Tests');
      disp('Designs cloud Tests');
      disp('Designs cloud Tests');
      disp('Designs cloud Tests');
      disp('Designs cloud Tests');
      disp('Designs cloud Tests');
    assessment "Assessment7": At any point of time, D must be less than C or greater than B
    assessment "Assessment8": At any point of time, E must be greater than F and less than G
      B: not mapped
      C: not mapped
      D: not mapped
      E: not mapped
      F: not mapped
      G: not mapped
    iteration script:
      testItr = sltestiteration();
      disp('right tc pre load-Simulation 1');
      disp('Designs cloud Tests');
      disp('You can use the Test Manager to create test cases for Simulink® models and code in desktop, SIL, PIL, and HIL (for target computers running Simulink Real-Time™) execution environments. You can create or import test data, run tests, view results, and create reports. You can also import and test C and C++ code, and MATLAB® test scripts. ')
      disp('Designs cloud Tests');
      disp('Designs cloud Tests');
      disp('Designs cloud Tests');
      disp('Designs cloud Tests');
      disp('Designs cloud Tests');
      disp('Designs cloud Tests');
      disp('Designs cloud Tests');
      disp('Designs cloud Tests');
      disp('Designs cloud Tests');
      disp('Designs cloud Tests');
      disp('Designs cloud Tests');
      disp('Designs cloud Tests');
      disp('Designs cloud Tests');
      disp('Designs cloud Tests');
      %% Iterate over all Parameter Sets.

      % Determine the number of possible iterations
      numSteps = length(sltest_parameterSets{1});

      % Create each iteration
      for k = 1 : numSteps
          % Set up a new iteration object
          testItr = sltestiteration();

          % Set iteration settings
          setTestParam(testItr, 'ParameterSet', sltest_parameterSets{1}{k}, 'SimulationIndex', 1);

          % Register the iteration to run in this test case
          addIteration(sltest_testCase, testItr); % You can pass in an optional iteration name
      end