test file "dTest_EquivalenceTestCaseMine"
  tags: Mine, File
  coverage: Decision

suite "New Test Suite 1"
  tags: RightFile

  case "TestCase" [baseline]
    description: Mine Test Case
    pre-load callback:
      The following variables have been pre-defined for you:
      sltest_iterationName: Name of current test iteration
      sltest_testIteration: Current test iteration object
      sltest_testCase: Current test case object
    post-load callback:
      The following variables have been pre-defined for you:
      sltest_bdroot   : Model simulated by the test case. Can be a harness model
      sltest_sut      : The system under test. For a harness, it is the component under test
      sltest_isharness: Returns true if sltest_bdroot is a harness model
      sltest_iterationName: Name of current test iteration
      sltest_testIteration: Current test iteration object
      sltest_testCase: Current test case object
    cleanup callback:
      The following variables have been pre-defined for you:
      sltest_simout : Simulation output produced by simulation
      sltest_iterationName: Name of current test iteration
      sltest_testIteration: Current test iteration object
      sltest_testCase: Current test case object

  case "TestCase2" [equivalence]

  case "TestCase3" [simulation]