test file "diffViewTestModel"
  description: #design Clouds
  tags: #DC, 1
  setup callback:
    disp('right tc pre load-Simulation 1');
    disp('Designs cloud Tests');
    disp('You can use the Test Manager to create test cases for Simulink® models and code in desktop, SIL, PIL, and HIL (for target computers running Simulink Real-Time™) execution environments. You can create or import test data, run tests, view results, and create reports. You can also import and test C and C++ code, and MATLAB® test scripts. ')
    disp('Designs cloud Tests');
    disp('Designs cloud Tests');
    disp('Designs cloud Tests');
    disp('Designs cloud Tests');
    disp('Designs cloud Tests');
    disp('Designs cloud Tests');
    disp('Designs cloud Tests');
    disp('Designs cloud Tests');
    disp('Designs cloud Tests');
    disp('Designs cloud Tests');
    disp('Designs cloud Tests');
    disp('Designs cloud Tests');
    disp('Designs cloud Tests');
    disp('Designs cloud Tests');
  cleanup callback: same code as in setup callback of test file "diffViewTestModel"
  coverage: Decision, MCDC, SignalRange, SimulinkDesignVerifier, RelationalBoundary, Condition, LookupTable, SignalSize, SaturationOnIntOverflow

suite "Test Suite For Design Cloud"
  setup callback:
    disp('right tc pre load-Simulation 1');
    disp('Designs cloud Tests');
    disp('You can use the Test Manager to create test cases for Simulink® models and code in desktop, SIL, PIL, and HIL (for target computers running Simulink Real-Time™) execution environments. You can create or import test data, run tests, view results, and create reports. You can also import and test C and C++ code, and MATLAB® test scripts. ')
    disp('Designs cloud Tests');
    disp('Designs cloud Tests');
    disp('Designs cloud Tests');
    disp('Designs cloud Tests');
    disp('Designs cloud Tests');
    disp('Designs cloud Tests');
    disp('Designs cloud Tests');
    disp('Designs cloud Tests');
    disp('Designs cloud Tests');
    disp('Designs cloud Tests');
    disp('Designs cloud Tests');
    disp('Designs cloud Tests');
    disp('Designs cloud Tests');
    disp('Designs cloud Tests');
    disp('Designs cloud Tests');
  cleanup callback: same code as in setup callback of test file "diffViewTestModel"

  case "Equivalence Test Case" [equivalence]
    description: Verify model equivalence in normal and SIL simulation mode.
      This example shows how to test for equivalence between two models using test harnesses and the test manager. One model runs in normal mode, and a test harness model created from a subsystem runs in software-in-the-loop (SIL) mode.
      The equivalence test case in the test manager compares signal output between two simulations to determine equivalence. Signals from the main model and the test harness are set up for logging in this example. The logged signals are used as the equivalence criteria between normal and SIL mode.
      Configure the Model Open the sltestNormalSILEquivalenceExample model. mdl = 'sltestNormalSILEquivalenceExample'; harnessOwner = 'sltestNormalSILEquivalenceExample/Controller'; open_system(mdl);
      Turn on signal logging in the model. set_param(mdl,'SignalLogging','on','SignalLoggingName', 'SIL_signals'); Mark the Controller subsystem output and input signals for logging. ph_controller_in = get_param('sltestNormalSILEquivalenceExample/Controller/In1','PortHandles'); ph_controller_out = get_param('sltestNormalSILEquivalenceExample/Controller','PortHandles'); set_param(ph_controller_in.Outport(1),'DataLogging','on'); set_param(ph_controller_out.Outport(1),'DataLogging','on'); clear ph_controller_in ph_controller_out; Simulate the model and output the logged signals. The signal data is used as input for the test harness. out = sim(mdl); Get the logged signal data. out_data = out.get('SIL_signals'); control_in1 = out_data.get(2);
      Create a Test Harness for SIL Verification. The command to create the harness will generate code. Switch to a directory with write permissions. origDir = pwd; dirName = tempname; mkdir(dirName); cd(dirName); cleanup = onCleanup(@()cd(origDir)); sltest.harness.create(harnessOwner,'Name','SIL_Harness','VerificationMode','SIL'); ### Starting build procedure for: Controller ### Successful completion of build procedure for: Controller ### Creating SIL block ... Building with 'gcc'. MEX completed successfully. Build Summary Top model targets built: Model Action Rebuild Reason ============================================================================================ Controller Code generated and compiled. Code generation information file does not exist. 1 of 1 models built (0 models already up to date) Build duration: 0h 0m 42.627s
    tags: Equivalence, Test, case, Simulink, Model, Block, Input, Output, Signal, Simulation, Verification, Validation, Comparison, Boundary, Range, Error, handling
    test data file: mCruise_control_sldvdataTheirs.xlsx
    simulation 1:
      model mAllIterationOptionsTheirs, harness mAllIterationOptionsTheirs_Harness2 (for mAllIterationOptionsTheirs/Subsystem), mode Normal, start time 5, stop time 100, initial state true
      configuration set: Configuration1
      parameter set "Parameter Set 1" (off): b = 3.1412  % model workspace
      parameter set "dInputs_LaunchData2.mat" (off): ts1 = 1x1 timeseries, ts2 = 1x1 timeseries
      parameter set "dBaseline_RightTest.mat": data = 1x1 Simulink.SimulationData.Dataset
      parameter set "dBaseline_RightTest_Theirs.mat" (off): data = 1x1 Simulink.SimulationData.Dataset
      input "dBaseline_RightTest_Theirs.mat"
      input "dInputs_LaunchData2.mat"
      input "dBaseline_RightTest.mat"
      input "Test case_1" from mCruise_control_sldvdataMine.xlsx (active)
      input "Test case_2" from mCruise_control_sldvdataMine.xlsx
      input "Test case_3" from mCruise_control_sldvdataMine.xlsx
      input "Test case_1 (1)" from mCruise_control_sldvdataTheirs.xlsx, sheet Test case_1
      input "Test case_2 (1)" from mCruise_control_sldvdataTheirs.xlsx, sheet Test case_2
      input "Test case_3 (1)" from mCruise_control_sldvdataTheirs.xlsx, sheet Test case_3
      input "Test case_1 (2)" from mCruise_control_sldvdataMine.xlsx, sheet Test case_1
      input "Test case_2 (2)" from mCruise_control_sldvdataMine.xlsx, sheet Test case_2
      input "Test case_3 (2)" from mCruise_control_sldvdataMine.xlsx, sheet Test case_3
      input "dInputs_LaunchData2.mat (1)" from dInputs_LaunchData2.mat
      logged signals "Signal Set 1": Output Conversion Subsystem:1, Input Conversion Subsystem:1, In1:1, Output Conversion Subsystem:1
      logged signals "Signal Set 2" (off): In1:1
      logged signals "Signal Set 3" (off): Input Conversion Subsystem:1
      logged signals "Signal Set 4" (off): Subsystem:1, Output Conversion Subsystem:1
      start logging when A == true
      stop logging after 600 s
      pre-load callback: same code as in setup callback of test file "diffViewTestModel"
      post-load callback: same code as in setup callback of test file "diffViewTestModel"
      cleanup callback: same code as in setup callback of test file "diffViewTestModel"
    simulation 2:
      model mAllIterationOptions, harness mAllIterationOptions_Harness1 (for mAllIterationOptions/Subsystem), mode Rapid Accelerator
      parameter set "Parameter Set 2": a = 9.8  % model workspace
      input "dInputs_LaunchData2.mat" (active)
      logged signals "Signal Set 2": Gain:1
      pre-load callback:
        disp('right tc post load-Simulation 2');
      post-load callback:
        disp('right tc pre load-Simulation 2');
      cleanup callback:
        disp('right tc cleanup-Simulation 2');
    equivalence criteria
      Out1
    custom criteria:
      test.verifyTrue(true);
      disp('right tc pre load-Simulation 1');
      disp('Designs cloud Tests');
      disp('You can use the Test Manager to create test cases for Simulink® models and code in desktop, SIL, PIL, and HIL (for target computers running Simulink Real-Time™) execution environments. You can create or import test data, run tests, view results, and create reports. You can also import and test C and C++ code, and MATLAB® test scripts. ')
      disp('Designs cloud Tests');
      disp('Designs cloud Tests');
      disp('Designs cloud Tests');
      disp('Designs cloud Tests');
      disp('Designs cloud Tests');
      disp('Designs cloud Tests');
      disp('Designs cloud Tests');
      disp('Designs cloud Tests');
      disp('Designs cloud Tests');
      disp('Designs cloud Tests');
      disp('Designs cloud Tests');
      disp('Designs cloud Tests');
      disp('Designs cloud Tests');
      disp('Designs cloud Tests');
    assessment callback:
      A=100;
      disp('right tc pre load-Simulation 1');
      disp('Designs cloud Tests');
      disp('You can use the Test Manager to create test cases for Simulink® models and code in desktop, SIL, PIL, and HIL (for target computers running Simulink Real-Time™) execution environments. You can create or import test data, run tests, view results, and create reports. You can also import and test C and C++ code, and MATLAB® test scripts. ')
      disp('Designs cloud Tests');
      disp('Designs cloud Tests');
      disp('Designs cloud Tests');
      disp('Designs cloud Tests');
      disp('Designs cloud Tests');
      disp('Designs cloud Tests');
      disp('Designs cloud Tests');
      disp('Designs cloud Tests');
      disp('Designs cloud Tests');
      disp('Designs cloud Tests');
      disp('Designs cloud Tests');
      disp('Designs cloud Tests');
      disp('Designs cloud Tests');
      disp('Designs cloud Tests');
    assessment "Assessment7": At any point of time, D must be less than C or greater than B
    assessment "Assessment8": At any point of time, E must be greater than F and less than G
      B: not mapped
      C: not mapped
      D: not mapped
      E: not mapped
      F: not mapped
      G: not mapped
    iterations:
      Iteration1
      Iteration2
      Iteration3
      Iteration4
      Iteration5
      Iteration6
      Iteration7
    iteration script:
      testItr = sltestiteration();
      disp('right tc pre load-Simulation 1');
      disp('Designs cloud Tests');
      disp('You can use the Test Manager to create test cases for Simulink® models and code in desktop, SIL, PIL, and HIL (for target computers running Simulink Real-Time™) execution environments. You can create or import test data, run tests, view results, and create reports. You can also import and test C and C++ code, and MATLAB® test scripts. ')
      disp('Designs cloud Tests');
      disp('Designs cloud Tests');
      disp('Designs cloud Tests');
      disp('Designs cloud Tests');
      disp('Designs cloud Tests');
      disp('Designs cloud Tests');
      disp('Designs cloud Tests');
      disp('Designs cloud Tests');
      disp('Designs cloud Tests');
      disp('Designs cloud Tests');
      disp('Designs cloud Tests');
      disp('Designs cloud Tests');
      disp('Designs cloud Tests');
      disp('Designs cloud Tests');
      %% Iterate over all Parameter Sets.

      % Determine the number of possible iterations
      numSteps = length(sltest_parameterSets{1});

      % Create each iteration
      for k = 1 : numSteps
          % Set up a new iteration object
          testItr = sltestiteration();

          % Set iteration settings
          setTestParam(testItr, 'ParameterSet', sltest_parameterSets{1}{k}, 'SimulationIndex', 1);

          % Register the iteration to run in this test case
          addIteration(sltest_testCase, testItr); % You can pass in an optional iteration name
      end

  case "Real-Time Load From Model Case" [real-time]
    description: 1. Check Load Application is Model
      2. Check if the Target Computer names are rendered
      3. stop time
    model libModel, stop time 10, target computer PIC 8051

  case "Real-Time Load From Target Application Case" [real-time]
    description: 1. Check Load Application is Model
      2. Check if the Target Computer names are rendered
      3.Target Application Field
      3. stop time
    model libModel, stop time 10, target computer PIC 8051, application TargetApplication.exe

  case "Real-Time Load From Target Computer Case" [real-time]
    description: 1. Check Load Application is Model
      2. Check if the Target Computer names are rendered
      3. stop time
    model libModel, stop time 10, target computer PIC 8051

  case "Simulation Test Case" [simulation]
    test data file: 
    model /home/neham/Downloads/mldatx/mCruise_control_sldvdataTheirs.xlsx

  case "Baseline Test Case" [baseline]
    test data file: 
    model mAllIterationOptions, mode Rapid Accelerator
    configuration set: test variable name from dBaseline_RightTest_Theirs.mat
    parameter set "Parameter Set 1":
      a = 9.8  % model workspace
      b = 3.1412  % model workspace
      tuvar = [0:10]  % mask workspace, mAllIterationOptions/Signal Builder
    input "dBaseline_RightTest.mat" (active)
    input "dBaseline_RightTest_Theirs.mat"
    input "Test case_1" from mCruise_control_sldvdataMine.xlsx
    input "Test case_2" from mCruise_control_sldvdataMine.xlsx
    input "Test case_3" from mCruise_control_sldvdataMine.xlsx
    input "Test case_1 (1)" from mCruise_control_sldvdataTheirs.xlsx, sheet Test case_1
    input "Test case_2 (1)" from mCruise_control_sldvdataTheirs.xlsx, sheet Test case_2
    input "Test case_3 (1)" from mCruise_control_sldvdataTheirs.xlsx, sheet Test case_3
    logged signals "Signal Set 1": Subsystem:1, Gain1:1, In2:1, Signal Builder:1, Gain:1, In1:1, Sum:1
    pre-load callback: same code as in setup callback of test file "diffViewTestModel"
    post-load callback: same code as in setup callback of test file "diffViewTestModel"
    cleanup callback:
      disp('right tc pre load-Simulation 1');
      disp('Designs cloud Tests');
      disp('You can use the Test Manager to create test cases for Simulink® models and code in desktop, SIL, PIL, and HIL (for target computers running Simulink Real-Time™) execution environments. You can create or import test data, run tests, view results, and create reports. You can also import and test C and C++ code, and MATLAB® test scripts. ')
      disp('Designs cloud Tests');
      disp('Designs cloud Tests');
      disp('Designs cloud Tests');
      disp('Designs cloud Tests');
      disp('Designs cloud Tests');
      disp('Designs cloud Tests');
      disp('Designs cloud Tests');
      disp('Designs cloud Tests');
      disp('Designs cloud Tests');
      disp('Designs cloud Tests');
      disp('Designs cloud Tests');
      disp('Designs cloud Tests');
      disp('Designs cloud Tests');
      disp('Designs cloud Tests');disp('right tc pre load-Simulation 1');
      disp('Designs cloud Tests');
      disp('You can use the Test Manager to create test cases for Simulink® models and code in desktop, SIL, PIL, and HIL (for target computers running Simulink Real-Time™) execution environments. You can create or import test data, run tests, view results, and create reports. You can also import and test C and C++ code, and MATLAB® test scripts. ')disp('right tc pre load-Simulation 1');
      disp('Designs cloud Tests');
      disp('You can use the Test Manager to create test cases for Simulink® models and code in desktop, SIL, PIL, and HIL (for target computers running Simulink Real-Time™) execution environments. You can create or import test data, run tests, view results, and create reports. You can also import and test C and C++ code, and MATLAB® test scripts. ')
      disp('Designs cloud Tests');
      disp('Designs cloud Tests');
      disp('Designs cloud Tests');
      disp('Designs cloud Tests');
      disp('Designs cloud Tests');
      disp('Designs cloud Tests');
      disp('Designs cloud Tests');
      disp('Designs cloud Tests');
      disp('Designs cloud Tests');
      disp('Designs cloud Tests');
      disp('Designs cloud Tests');
      disp('Designs cloud Tests');
      disp('Designs cloud Tests');
      disp('Designs cloud Tests');
      disp('Designs cloud Tests');
      disp('Designs cloud Tests');
      disp('Designs cloud Tests');
      disp('Designs cloud Tests');
      disp('Designs cloud Tests');
      disp('Designs cloud Tests');
      disp('Designs cloud Tests');
      disp('Designs cloud Tests');
      disp('Designs cloud Tests');
      disp('Designs cloud Tests');
      disp('Designs cloud Tests');
      disp('Designs cloud Tests');
      disp('Designs cloud Tests');
      disp('Designs cloud Tests');
    baseline "dBaseline_RightTest.mat"
      Out1:1
      Out2:1
    baseline "dInputs_LaunchData2.mat"
      LaunchData
      LaunchData
    baseline "dBaseline_RightTest.mat (1)"
      Out1:1
      Out2:1
    baseline "dBaseline_RightTest.mat (2)"
      Out1:1
      Out2:1
    baseline "dBaseline_RightTest.mat (3)"
      Out1:1
      Out2:1
    baseline "dBaseline_RightTest_Theirs.mat"
      Out1:1
      Out2:1
    baseline "dBaseline_RightTest_Theirs.mat (1)"
      Out1:1
      Out2:1
    baseline "dBaseline_RightTest_Theirs.mat (2)"
      Out1:1
      Out2:1
    baseline "dBaseline_RightTest_Theirs.mat (3)"
      Out1:1
      Out2:1
    baseline "dBaseline_RightTest_Theirs.mat (4)"
      Out1:1
      Out2:1
    custom criteria: same code as in setup callback of test file "diffViewTestModel"
    assessment callback: same code as in setup callback of test file "diffViewTestModel"
    iterations:
      Iteration1: ExternalInput "dBaseline_RightTest.mat"
      Iteration2: ExternalInput "dBaseline_RightTest_Theirs.mat"
      Iteration3: ExternalInput "Test case_1"
      Iteration4: ExternalInput "Test case_2"
      Iteration5: ExternalInput "Test case_3"
      Iteration6: ExternalInput "Test case_1 (1)"
      Iteration7: ExternalInput "Test case_2 (1)"
      Iteration8: ExternalInput "Test case_3 (1)"

  case "Disabled Equivalence Test" [equivalence] (disabled)

suite "Default Test Suit For Design Cloud"

  case "Baseline Test Case" [baseline]

  case "Equivalence Test Case" [equivalence]

  case "Simulation Test Case" [simulation]

  case "Real-Time Test Case (Simulation Test)" [real-time]

  case "Real-Time Test Case (Baseline Test)" [real-time]

  case "Real-Time Test Case (Equivalence-Simulation 1 Test)" [real-time]

  case "Real-Time Test Case (Equivalence Test)" [real-time]

  case "Road Runner Test Case"

  case "New Test Case 1" [baseline]

  suite "New Test Suite 1"